# Grasshopper definition Grasshopper JSON Generation.ghx (Grasshopper 1.0.7)

ghpython_script = GhPythonScript(
    JSON_name="JSON_from_GH",
    target_dist=Slider(0.5, range=0..1),
    tolerable_range=Slider(0.04, range=0..0.1),
    toleration_times=Slider(10, range=0..10),
    Generate_JSON=Button())  # inputs toleration_times: Int32, Generate_JSON: Boolean
# ---------- ghpython_script: Python ----------
import json
import os

#JSON_name = 'test_8-9-2022.json'

ghComp = ghenv.Component
ghDoc = ghComp.OnPingDocument()

DATA_PATH = ghDoc.FilePath
DATA_PATH = os.path.abspath(os.path.join(DATA_PATH, ".."))

if __name__ == "__main__":
    if target_dist == None:
        target_dist = 1.35
    if tolerable_range == None:
        tolerable_range = 1.5
    if toleration_times == None:
        toleration_times = 0

JSON_dict = {}
JSON_dict["target_dist"] = ("%.3f" % target_dist)
JSON_dict["tolerable_range"] = ("%.3f" % tolerable_range)
JSON_dict["toleration_times"] = toleration_times

if JSON_name[-5:] != ".json":
    JSON_name = JSON_name + ".json"

filename = os.path.join(DATA_PATH, JSON_name)

if Generate_JSON == True:
    with open(filename, 'w') as f:
        f.write(json.dumps(JSON_dict, sort_keys=False))
# ---------- end ghpython_script ----------
