# Grasshopper definition Grasshopper JSON Generation.ghx (Grasshopper 1.0.7)

number_slider = Slider(10, range=0..10)
number_slider_2 = Slider(25, range=0..100)
series = Series(Start=number_slider, Step=number_slider_2, Count=10)
series_2 = Series(Start=number_slider, Step=number_slider_2, Count=Slider(5, range=0..10))
construct_point = ConstructPoint(XCoordinate=series, YCoordinate=0, ZCoordinate=0)
vector_xyz = VectorXYZ(XComponent=graft(series_2), YComponent=series_2, ZComponent=0)  # -> Vector, Length
line_sdl = LineSDL(Start=construct_point, Direction=vector_xyz.Vector, Length=vector_xyz.Length)  # -> simplify(Line)
flip_matrix = FlipMatrix(Data=line_sdl)

tree_statistics = TreeStatistics(Tree=flip_matrix)  # -> Paths, Length, Count
list_length = ListLength(List=tree_statistics.Paths)
construct_domain = ConstructDomain(DomainStart=0, DomainEnd=expr("x-1", list_length))
remap_numbers = RemapNumbers(Value=Slider(73, range=0..100), Source=Domain(0, 100), Target=construct_domain)  # -> Mapped, Clipped
round = Round(Number=remap_numbers.Mapped)  # -> Nearest, Floor, Ceiling
list_item = ListItem(List=tree_statistics.Length, Index=round.Nearest, Wrap=True)
construct_domain_2 = ConstructDomain(DomainStart=0, DomainEnd=expr("x-1", list_item))
remap_numbers_2 = RemapNumbers(Value=Slider(38, range=0..100), Source=Domain(0, 100), Target=construct_domain_2)  # -> Mapped, Clipped
tree_branch = TreeBranch(Tree=flip_matrix, Path=round.Nearest, MaintainPaths=True)
round_2 = Round(Number=remap_numbers_2.Mapped)  # -> Nearest, Floor, Ceiling
list_item_2 = ListItem(List=tree_branch, Index=round_2.Nearest, Wrap=True)

panel = Panel([round.Nearest, round_2.Nearest])
ghpython_script = GhPythonScript(
    JSON_name="JSON_from_GH",
    rope_branch=round.Nearest,
    rope_index=round_2.Nearest,
    target_dist=Slider(0.5, range=0..1),
    tolerable_dist=Slider(0.04, range=0..0.1),
    toleration_times=Slider(10, range=0..10),
    Generate_JSON=Button())  # -> out; inputs rope_branch: Int32, rope_index: Int32, toleration_times: Int32, Generate_JSON: Boolean
# ---------- ghpython_script: Python ----------
import json
import os
import sys
import datetime as dt

ghComp = ghenv.Component
ghDoc = ghComp.OnPingDocument()

DATA_PATH = ghDoc.FilePath
DATA_PATH = os.path.abspath(os.path.join(DATA_PATH, ".."))

date_now = dt.datetime.now()
date = date_now.strftime("%x") + date_now.strftime(" %X")

if __name__ == "__main__":
    if type(target_dist) == type(None):
        print("ERROR \nERROR \nERROR \nPoint out of reach of robot")
        sys.exit()
    if tolerable_dist == None:
        tolerable_dist = 1.5
    if toleration_times == None:
        toleration_times = 0
    if rope_branch == None or rope_index == None:
        print("ERROR \nERROR \nERROR \nrope_branch or rope_index not given or int")
        sys.exit()

rope_name = "branch" + str(rope_branch) + "_index" + str(rope_index) + ".json"

JSON_dict = {}
JSON_dict["target_dist"] = ("%.3f" % target_dist)
JSON_dict["tolerable_dist"] = ("%.3f" % tolerable_dist)
JSON_dict["toleration_times"] = toleration_times
JSON_dict["export_JSON"] = rope_name
JSON_dict["date_time"] = date

if JSON_name[-5:] != ".json":
    JSON_name = JSON_name + ".json"

filename = os.path.join(DATA_PATH, JSON_name)

if Generate_JSON == True:
    with open(filename, 'w') as f:
        f.write(json.dumps(JSON_dict, sort_keys=False))
# ---------- end ghpython_script ----------
